# Dynamo graph export all schedules by name_p.dyn (Dynamo 2.3.0.5885)

element_types = ElementTypes("ViewSchedule")
all_elements_of_type = ElementsOfType(element_type=element_types)

# group: INPUT
view_name_starts_with = StringInput("Výkaz")  # graph input
directory_path = Directory("C:\")  # graph input

# group: FILTER
code_block = CodeBlock { "View Name"; }
getParameterValueByName = Element.GetParameterValueByName(element=all_elements_of_type, parameterName=code_block)
startsWith = String.StartsWith(str=getParameterValueByName, searchFor=view_name_starts_with)
filterByBoolMask = List.FilterByBoolMask(list=all_elements_of_type, mask=startsWith)

name = Element.Name(element=filterByBoolMask.in)
code_block_2 = CodeBlock(FileName=name) { FileName + ".txt"; }
python_script = Python(IN[0]=filterByBoolMask.in, IN[1]=directory_path, IN[2]=code_block_2)
# ---------- python_script.python (18 lines) ----------
import clr
clr.AddReference("RevitAPI")
from Autodesk.Revit.DB import *

schedule_list = IN[0]
path = IN[1]
filename_list = IN[2]
result_list = []

for index, sched in enumerate(schedule_list):
	schedule = UnwrapElement(sched)
	filename = filename_list[index]
	try:
		export_options = ViewScheduleExportOptions()
		schedule.Export(path, filename, export_options)
		result_list.append("Schedule Exported ")
	except: result_list.append("Failure ")
OUT = result_list
# ----------------------------------------
status = Watch(python_script)
watch = Watch(name)
návod = StringInput("Vyexportuje vsetky tabulky zacinajuce danym retazcom do samostatnych txt suborov do urceneho folderu.")  # graph input
